# Grasshopper definition nakagin-capsule-tower-speckle.gh (Grasshopper 1.0.7)
# plug-ins: semio

toggle = BooleanToggle(True)
curdir = CurrentDirectory()  # -> D, P, S
# ---------- curdir: Python ----------
#Component Information
#--------------------------------------------------------------------------------------------
if ghenv.Component.RunCount<2:
    #General
    #--------------------------------------------------------------------------------------------
    __author__ = "Ueli Saluz"
    __version__ = "2023.09.29"
    
    ghenv.Component.Name = "CurrentDirectory"
    ghenv.Component.NickName = "CurDir"
    ghenv.Component.Description = "Current directory of the current grasshopper file."
    ghenv.Component.Message = "VER 1.0"
    ghenv.Component.Category = "Params"
    ghenv.Component.SubCategory = "Util"
    
    #Outputs
    #--------------------------------------------------------------------------------------------
    outputIndex=0
    
    ghenv.Component.Params.Output[outputIndex].Name = "Directory"
    ghenv.Component.Params.Output[outputIndex].NickName = "D"
    ghenv.Component.Params.Output[outputIndex].Description = "Directory of the current grasshopper file."
    outputIndex+=1
    
    ghenv.Component.Params.Output[outputIndex].Name = "Path"
    ghenv.Component.Params.Output[outputIndex].NickName = "P"
    ghenv.Component.Params.Output[outputIndex].Description = "Path of the current grasshopper file."
    outputIndex+=1
    
    ghenv.Component.Params.Output[outputIndex].Name = "Separator"
    ghenv.Component.Params.Output[outputIndex].NickName = "S"
    ghenv.Component.Params.Output[outputIndex].Description = "Separator of the current system."
    outputIndex+=1

#Imports
#--------------------------------------------------------------------------------------------
from os.path import dirname
from os import sep

#Solver - Run with trees to enhance performance drastically
#--------------------------------------------------------------------------------------------
if __name__ == "__main__":
    P = ghenv.Component.OnPingDocument().FilePath
    D = dirname(P)
    S = sep
# ---------- end curdir ----------
kit = LoadKit(Directory=curdir.D, Run=toggle)  # -> Name, Description, Icon, Url, Homepage, Types, Formations
trim = TrimTree(Tree=kit.Formations, Depth=1)
for = ModelFormation(Formation=trim)  # -> Formation, Name, Description, Icon, Variant, Unit, Pieces, Connections, Qualities
expression = Expression(x=for.Variant, y="Futuristic", Expression="x=y")
expression_2 = Expression(x=for.Name, y="Nakagin Capsule Tower", Expression="x=y")
expression_3 = Expression(x=for.Variant, Expression="x=y")
and = GateAnd(A=expression_2, B=expression_3)
and_2 = GateAnd(A=expression_2, B=expression)
cull = CullPattern(List=trim, CullPattern=and)
cull_2 = CullPattern(List=trim, CullPattern=and_2)
for_2 = ModelFormation(Formation=cull)  # -> Formation, Name, Description, Icon, Variant, Unit, Pieces, Connections, Qualities
scn = GetScene(FormationName=for_2.Name, FormationVariant=for_2.Variant, Run=toggle)
scn_2 = FilterScene(Scene=scn, Tags="volume")  # -> Representations, Planes, PiecesIds, ParentsPiecesIds
trim_2 = TrimTree(Tree=scn_2.Representations, Depth=1)
trim_3 = TrimTree(Tree=scn_2.Planes, Depth=1)
rep = ModelRepresentation(Representation=trim_2)  # -> Representation, Url, LevelOfDetail, Tags
